# Grasshopper definition SynthAnthro_SkeletalModel_3.gh (Grasshopper 1.0.8)

list = ValueList({"MALE", "FEMALE"}, selected="FEMALE")
path = FilePath("/Users/briancox/Dropbox/GitHub/MTWABP/Tools/SyntheticAnthropometry/CAESAR/OBJ/")
pyfourdigitoutput_1 = Python3Script(inputPath=path, inputGender=list, inputSlider=Slider(72, range=0..5000))  # -> out, outputFilePath
# ---------- pyfourdigitoutput_1: Python ----------
inputNumber = int(inputSlider)
outputFilePath = f"{inputPath}SPRING_{inputGender}/SPRING{inputNumber:04d}.obj"
# ---------- end pyfourdigitoutput_1 ----------
panel = Panel(pyfourdigitoutput_1.outputFilePath)
_3dm = Import3DM(File=pyfourdigitoutput_1.outputFilePath, Layer="*", Name="*")
scale = Scale(Geometry=_3dm, Center=Point(0, 0, 0), Factor=Slider(1000, range=0..1000))  # -> Geometry, Transform
geo = Geometry(scale.Geometry)
demesh = DeconstructMesh(Mesh=geo)  # -> Vertices, Faces, Colours, Normals
pt = Point(<point referenced from the Rhino model>)
cp = ClosestPoint(Point=pt, Cloud=demesh.Vertices)  # -> ClosestPoint, CPIndex, Distance
panel_2 = Panel(cp.CPIndex)

# ---- group: LENGTHS / SHOULDER POMS
item = ListItem(List=demesh.Vertices, Index="10681", Wrap=True)
item_2 = ListItem(List=demesh.Vertices, Index="10559", Wrap=True)
ln = Line(StartPoint=item, EndPoint=item_2)

# ---- group: LENGTHS / HIP POMS
item_3 = ListItem(List=demesh.Vertices, Index="5965", Wrap=True)
item_4 = ListItem(List=demesh.Vertices, Index="6025", Wrap=True)
ln_2 = Line(StartPoint=item_3, EndPoint=item_4)

# ---- group: CIRC_HEAD
item_5 = ListItem(List=demesh.Vertices, Index="12134", Wrap=True)
item_6 = ListItem(List=demesh.Vertices, Index="12082", Wrap=True)
item_7 = ListItem(List=demesh.Vertices, Index="12099", Wrap=True)
item_8 = ListItem(List=demesh.Vertices, Index="12116", Wrap=True)
item_9 = ListItem(List=demesh.Vertices, Index="11890", Wrap=True)
item_10 = ListItem(List=demesh.Vertices, Index="11997", Wrap=True)
item_11 = ListItem(List=demesh.Vertices, Index="12019", Wrap=True)
item_12 = ListItem(List=demesh.Vertices, Index="12047", Wrap=True)
item_13 = ListItem(List=demesh.Vertices, Index="12064", Wrap=True)
item_14 = ListItem(List=demesh.Vertices, Index="12050", Wrap=True)
item_15 = ListItem(List=demesh.Vertices, Index="12006", Wrap=True)
item_16 = ListItem(List=demesh.Vertices, Index="12036", Wrap=True)
ln_3 = Line(StartPoint=item_5, EndPoint=item_6)
ln_4 = Line(StartPoint=item_6, EndPoint=item_8)
ln_5 = Line(StartPoint=item_7, EndPoint=item_9)
ln_6 = Line(StartPoint=item_8, EndPoint=item_7)
ln_7 = Line(StartPoint=item_9, EndPoint=item_10)
ln_8 = Line(StartPoint=item_10, EndPoint=item_13)
ln_9 = Line(StartPoint=item_11, EndPoint=item_12)
ln_10 = Line(StartPoint=item_12, EndPoint=item_14)
ln_11 = Line(StartPoint=item_14, EndPoint=item_16)
ln_12 = Line(StartPoint=item_13, EndPoint=item_11)
ln_13 = Line(StartPoint=item_15, EndPoint=item_5)
ln_14 = Line(StartPoint=item_16, EndPoint=item_15)

# ---- group: LENGTHS / KNEES
item_17 = ListItem(List=demesh.Vertices, Index="2826", Wrap=True)
item_18 = ListItem(List=demesh.Vertices, Index="2573", Wrap=True)
item_19 = ListItem(List=demesh.Vertices, Index="2645", Wrap=True)
item_20 = ListItem(List=demesh.Vertices, Index="2461", Wrap=True)
ln_15 = Line(StartPoint=item_19, EndPoint=item_20)
ln_16 = Line(StartPoint=item_17, EndPoint=item_18)
midpt = CurveMiddle(Curve=ln_16)
midpt_2 = CurveMiddle(Curve=ln_15)

# ---- group: LENGTHS / FEET
item_21 = ListItem(List=demesh.Vertices, Index="451", Wrap=True)
item_22 = ListItem(List=demesh.Vertices, Index="282", Wrap=True)
item_23 = ListItem(List=demesh.Vertices, Index="361", Wrap=True)
item_24 = ListItem(List=demesh.Vertices, Index="235", Wrap=True)
ln_17 = Line(StartPoint=item_22, EndPoint=item_21)
ln_18 = Line(StartPoint=item_24, EndPoint=item_23)

# ---- group: CIRC_HEAD / CIRC_NECK
item_25 = ListItem(List=demesh.Vertices, Index="10872", Wrap=True)
item_26 = ListItem(List=demesh.Vertices, Index="10963", Wrap=True)
item_27 = ListItem(List=demesh.Vertices, Index="11096", Wrap=True)
item_28 = ListItem(List=demesh.Vertices, Index="11054", Wrap=True)
item_29 = ListItem(List=demesh.Vertices, Index="11174", Wrap=True)
item_30 = ListItem(List=demesh.Vertices, Index="11179", Wrap=True)
item_31 = ListItem(List=demesh.Vertices, Index="11132", Wrap=True)
item_32 = ListItem(List=demesh.Vertices, Index="11109", Wrap=True)
item_33 = ListItem(List=demesh.Vertices, Index="11160", Wrap=True)
item_34 = ListItem(List=demesh.Vertices, Index="11037", Wrap=True)
item_35 = ListItem(List=demesh.Vertices, Index="10868", Wrap=True)
item_36 = ListItem(List=demesh.Vertices, Index="10953", Wrap=True)
ln_19 = Line(StartPoint=item_25, EndPoint=item_26)
ln_20 = Line(StartPoint=item_26, EndPoint=item_28)
ln_21 = Line(StartPoint=item_27, EndPoint=item_29)
ln_22 = Line(StartPoint=item_28, EndPoint=item_27)
ln_23 = Line(StartPoint=item_29, EndPoint=item_30)
ln_24 = Line(StartPoint=item_30, EndPoint=item_33)
ln_25 = Line(StartPoint=item_31, EndPoint=item_32)
ln_26 = Line(StartPoint=item_32, EndPoint=item_34)
ln_27 = Line(StartPoint=item_34, EndPoint=item_36)
ln_28 = Line(StartPoint=item_33, EndPoint=item_31)
ln_29 = Line(StartPoint=item_35, EndPoint=item_25)
ln_30 = Line(StartPoint=item_36, EndPoint=item_35)

# ---- group: LENGTHS / TORSO
midpt_3 = CurveMiddle(Curve=ln)
midpt_4 = CurveMiddle(Curve=ln_2)
ln_31 = Line(StartPoint=midpt_3, EndPoint=midpt_4)

# ---- group: LENGTHS / HEAD AND NECK
item_37 = ListItem(List=demesh.Vertices, Index="12456", Wrap=True)
item_38 = ListItem(List=demesh.Vertices, Index="11115", Wrap=True)
item_39 = ListItem(List=demesh.Vertices, Index="11293", Wrap=True)
ln_32 = Line(StartPoint=item_38, EndPoint=item_39)
midpt_5 = CurveMiddle(Curve=ln_32)
ln_33 = Line(StartPoint=midpt_3, EndPoint=midpt_5)
ln_34 = Line(StartPoint=item_37, EndPoint=midpt_5)

# ---- group: LENGTHS / LEGS
ln_35 = Line(StartPoint=midpt_4, EndPoint=item_3)
ln_36 = Line(StartPoint=midpt_4, EndPoint=item_4)
ln_37 = Line(StartPoint=midpt, EndPoint=item_22)
ln_38 = Line(StartPoint=midpt_2, EndPoint=item_24)
midpt_6 = CurveMiddle(Curve=ln_35)
midpt_7 = CurveMiddle(Curve=ln_36)
ln_39 = Line(StartPoint=midpt_6, EndPoint=midpt)
ln_40 = Line(StartPoint=midpt_7, EndPoint=midpt_2)
